# Grasshopper definition Fuso.gh (Grasshopper 1.0.7)

comprimento_l = Slider(151, range=0..500)

# ---- group: Zona de Dosagem (ZD)
multiplication = Multiplication(A=comprimento_l, B="0.3")

# ---- group: Zona de Alimentação (ZA)
multiplication_2 = Multiplication(A=comprimento_l, B="0.3")

# ---- group: Zona de Compressão (ZC)
multiplication_3 = Multiplication(A=comprimento_l, B="0.4")

# ---- group: Diametro
l_20 = Panel("20")
# GNU nano 7.2                                    Fuso.md                                             | **Parte** | **Tamanho** | **Profundidade** |
# |---|---|---|
# | Comprimento (L) | 20xD | - |
# | Diametro (D) | L/20 | - |
# | Passo da Rosca (P) | P=D | - |
# | Zona de Aliemntação (ZA) | Lx0.3 | Dx0.12 |
# | Zona de Compressão (ZC) | Lx0.4 | |
# | Zona de Dosagem (ZD) | Lx0.3 | Dx(0.03 ~ 0.05) |
# | Angulo | 17º ~ 20º | - |
division = Division(A=comprimento_l, B=l_20)

# ----
paso_da_rosca_p = Data(division)
circle = Circle(Plane=PlaneXY(0, 0, 0), Radius=division)
unit_z = UnitZ(Factor=comprimento_l)
surface = Surface(circle)
extrude = Extrude(Base=surface, Direction=unit_z)  # -> flatten(Extrusion)
deconstruct_brep = DeconstructBrep(Brep=extrude)  # -> Faces, Edges, Vertices
list_item = ListItem(List=deconstruct_brep.Faces, Index=0, Wrap=True)  # -> Item, Item1, Item2, Item3
divide_surface = DivideSurface(Surface=list_item.Item1, UCount=Slider(20, range=0..100), VCount="4")  # -> flatten(Points), Normals, Parameters
